# Grasshopper definition ShowStbModel.gh (Grasshopper 1.0.7)
# plug-ins: HoaryFox

# ↓Set your
# ST-Brigde file path
path = FilePath()
load_stb_file = LoadSTBFile(Path=path)

# ---- group: Show Model as Breps
# If true, Bake into Rhino layered
# by member type and section code.
button = Button()
stb_to_brep = StbToBrep(Data=load_stb_file, Bake=button)  # -> Columns, Girders, Posts, Beams, Braces, Slabs, Walls

# ---- group: Show Model as Lines
stb_to_line = StbToLine(Data=load_stb_file, Bake=Button())  # -> Nodes, Columns, Girders, Posts, Beams, Braces

# ---- group: Show Member Name
girder_name_tag = GirderNameTag(Data=load_stb_file, Size="12")
column_name_tag = ColumnNameTag(Data=load_stb_file, Size="12")

# ---- group: Show Section Infomation
column_section_tag = ColumnSectionTag(Data=load_stb_file, Size="12")
girder_section_tag = GirderSectionTag(Data=load_stb_file, Size="12")
